# Grasshopper definition 雨がかかる角度の抽出2.gh (Grasshopper 1.0.7)

mesh = Mesh(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)
facen = FaceNormals(Mesh=mesh)  # -> Centers, Normals
brep = Brep([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])
faceb = FaceBoundaries(Mesh=mesh)
python = GhPythonScript(mesh=mesh, centroid=facen.Centers, barrier=brep)  # -> vec_list, count_list, ans_count, ans_vec; inputs mesh: Mesh, centroid: list of Point3d, barrier: list of GeometryBase
# ---------- python: Python ----------
import rhinoscriptsyntax as rs
import Rhino.Geometry as rg
import math


ans_count = 0
#ans_vec(最終的な角度)


#各角度を定義する
max_angle = 90
min_angel = 60
vec_list = []
step = 5
axis1 = rg.Vector3d(0.0, 1.0, 0.0)
axis2 = rg.Vector3d(0.0, 0.0, 1.0)
for i in range(min_angel, max_angle, step):
    for k in range(0, 360, step):
        angleRad1 = math.radians(i)
        angleRad2 = math.radians(k)
        vec = rg.Vector3d(-1.0, 0.0, 0.0)
        re_vec1 = rg.Vector3d.Rotate(vec, angleRad1, axis1)
        re_vec2 = rg.Vector3d.Rotate(vec, angleRad2, axis2)
        vec_list.append(vec)

#光線を発射
count_list = []
ans_count = float("inf")
for dir in vec_list:
    count = 0
    for point in centroid:
        ray = rg.Ray3d(point, dir)
        rayshootevent = rg.Intersect.Intersection.RayShoot(barrier, ray, 1)
        count += len(rayshootevent)
    count_list.append(count)
    if count < ans_count:
        print("ok")
        ans_count = count
        ans_vec = dir
# ---------- end python ----------
line = LineSDL(Start=facen.Centers, Direction=python.ans_vec, Length="5000")
panel = Panel(python.ans_vec)
panel_2 = Panel(python.ans_count)
panel_3 = Panel(python.vec_list)
panel_4 = Panel(python.count_list)
